# Grasshopper definition 12 image+dividing 2 _laczenie kafelkow.gh (Grasshopper 1.0.7)
# plug-ins: Squid (ShapeDiver Edition), LunchBoxML, LunchBox, Kangaroo2 Components, Parakeet

panel = Panel("C:\Users\mateu\Documents\GitHub\hgh\TEST_IMAGE.jpg")
construct_domain = ConstructDomain(DomainStart=0, DomainEnd=Slider(200, range=10..1000))
construct_domain_2 = ConstructDomain(DomainStart=0, DomainEnd=Slider(400, range=10..1000))

read = Read(Path=panel)  # -> Bitmap, Bounds
dimensions = Dimensions(Surface=read.Bounds)  # -> UDimension, VDimension

# ---- group: inputy
cell_selection = Slider(0, range=0..1)
amount_of_colors_for_big_panels = Slider(8, range=2..20)
amount_of_colors_for_colors = Slider(8, range=2..20)
way_of_working = BooleanToggle(True)
number_slider = Slider(20, range=0..100)
amount_of_color_pickers = Slider(12, range=0..20)

# ----
rectangle = Rectangle(Plane=PlaneXY(0, 0, 0), XSize=construct_domain, YSize=construct_domain_2, Radius=0)  # -> Rectangle, Length

# ----
# area to be divided
number_slider_2 = Slider(7, range=1..100)
number_slider_3 = Slider(3, range=1..100)
value_list = ValueList({"diamond panels + triangle cells": {1;3}, "rectangle": 2, "triangle + triangle": {3;3}, "bricks": 4}, selected="bricks")
surface = Surface(rectangle.Rectangle)

dimensions_2 = Dimensions(Surface=surface)  # -> UDimension, VDimension
division = Division(A=dimensions_2.UDimension, B=Slider(13.79, range=0..100))
division_2 = Division(A=dimensions_2.VDimension, B=Slider(50, range=0..100))
round = Round(Number=division)  # -> Nearest, Floor, Ceiling
round_2 = Round(Number=division_2)  # -> Nearest, Floor, Ceiling
multiplication = Multiplication(A=round.Floor, B=2)
multiplication_2 = Multiplication(A=round_2.Floor, B=2)

division_3 = Division(A=dimensions.UDimension, B=number_slider)
construct_domain² = ConstructDomain²(UMin=0, UMax=1, VMin=0, VMax=1)
division_4 = Division(A=dimensions.VDimension, B=division_3)
divide_domain² = DivideDomain²(Domain=construct_domain², UCount=number_slider, VCount=division_4)
isotrim = Isotrim(Surface=reparameterize(read.Bounds), Domain=divide_domain²)
list_length = ListLength(List=isotrim)
import_image = ImportImage(File=panel, Rectangle=rectangle.Rectangle)
remap_numbers = RemapNumbers(Value=cell_selection, Source=Domain(0, 1), Target=list_length)  # -> Mapped, Clipped
list_item = ListItem(List=isotrim, Index=remap_numbers.Mapped, Wrap=True)
construct_domain²_2 = ConstructDomain²(UMin=0, UMax=1, VMin=0, VMax=1)
divide_domain²_2 = DivideDomain²(Domain=construct_domain²_2, UCount=amount_of_color_pickers, VCount=amount_of_color_pickers)
surface_2 = Surface(list_item)
isotrim_2 = Isotrim(Surface=reparameterize(graft(surface_2)), Domain=divide_domain²_2)

# ----
# dividing to panels
stream_gate = StreamGate(Stream=surface, Gate=value_list)  # -> Target0, Target1, Target2, Target3, Target4
diamond_panels = DiamondPanels(Surface=stream_gate.Target1, UDivisions=multiplication, VDivisions=multiplication_2)  # -> DiamondPanels, TriPanels
hexagon_cells = HexagonCells(Surface=stream_gate.Target0, UDivisions=multiplication, VDivisions=multiplication_2, TParameter=0.25)  # -> HexagonCells, Centers
quad_panels = QuadPanels(Surface=stream_gate.Target2, UDivisions=round.Floor, VDivisions=round_2.Floor)
triangular_panels_a = TriangularPanelsA(Surface=stream_gate.Target3, UDivisions=round.Floor, VDivisions=round_2.Floor)

brick_type_a = BrickTypeA(BaseSurface=stream_gate.Target4, UCount=round.Floor, VCount=round_2.Floor, OffsetDistance=0)
boundary_surfaces = BoundarySurfaces(Edges=brick_type_a)

merge = Merge(
    Data1=hexagon_cells.HexagonCells,
    Data2=[diamond_panels.DiamondPanels, diamond_panels.TriPanels],
    Data3=quad_panels,
    Data4=triangular_panels_a,
    Data5=flatten(boundary_surfaces))  # -> simplify(Result)

output_panels = Geometry(merge)

# ----
# area to be divided
number_slider_4 = Slider(10, range=1..100)
number_slider_5 = Slider(10, range=1..100)
value_list_2 = ValueList({"hexagonal": 0, "diamond": 1, "rectangle": 2, "triangle": 3, "bricks": 4}, selected="bricks")
surface_3 = Surface(output_panels)

area = Area(Geometry=output_panels)  # -> Area, Centroid
mesh_closest_point = MeshClosestPoint(Point=area.Centroid, Mesh=import_image)  # -> Point, Index, Parameter
mesh_eval = MeshEval(Mesh=import_image, Parameter=mesh_closest_point.Parameter)  # -> Point, Normal, Colour
colour = Colour(simplify(mesh_eval.Colour))
text_split = TextSplit(Text=flatten(colour), Separators=",")
k_means_clustering = KMeansClustering(TrainingInputs=text_split, OfClusters=amount_of_colors_for_big_panels, RandomSeed=3)  # -> Result, Likelihood, Centroids
list_item_2 = ListItem(List=k_means_clustering.Centroids, Index=0, Wrap=True)  # -> Item, Item1, Item2
colour_rgb = ColourRGB(Alpha=255, Red=list_item_2.Item, Green=list_item_2.Item1, Blue=list_item_2.Item2)  # -> flatten(Colour)
list_item_3 = ListItem(List=colour_rgb, Index=k_means_clustering.Result, Wrap=True)
dispatch = Dispatch(List=surface_3, DispatchPattern=way_of_working)  # -> ListA, ListB
dispatch_2 = Dispatch(List=list_item_3, DispatchPattern=way_of_working)  # -> ListA, ListB

# ----
# dividing to cells
stream_gate_2 = StreamGate(Stream=surface_3, Gate=value_list_2)  # -> Target0, Target1, Target2, Target3, Target4
diamond_panels_2 = DiamondPanels(Surface=stream_gate_2.Target1, UDivisions=number_slider_4, VDivisions=number_slider_5)  # -> DiamondPanels, TriPanels
quad_panels_2 = QuadPanels(Surface=stream_gate_2.Target2, UDivisions=number_slider_4, VDivisions=number_slider_5)
hexagon_cells_2 = HexagonCells(Surface=stream_gate_2.Target0, UDivisions=number_slider_4, VDivisions=number_slider_5, TParameter=0.25)  # -> HexagonCells, Centers

mesh = Mesh(stream_gate_2.Target3)
triremesh = TriRemesh(Geometry=mesh, Length=number_slider_4, Iterations=25)  # -> Triangulation, Dual, Creases
face_normals = FaceNormals(Mesh=triremesh.Triangulation)  # -> Centers, Normals
brick_type_a_2 = BrickTypeA(BaseSurface=stream_gate_2.Target4, UCount=number_slider_4, VCount=number_slider_5, OffsetDistance=0)
boundary_surfaces_2 = BoundarySurfaces(Edges=brick_type_a_2)
mesh_to_nurbs = MeshToNurbs(Mesh=triremesh.Triangulation)  # -> QuadrangularSurfaces, TriangularSurfaces

merge_2 = Merge(
    Data1=hexagon_cells_2.HexagonCells,
    Data2=[diamond_panels_2.DiamondPanels, diamond_panels_2.TriPanels],
    Data3=quad_panels_2,
    Data4=mesh_to_nurbs.TriangularSurfaces,
    Data5=boundary_surfaces_2)  # -> simplify(flatten(Result))

tree_branch = TreeBranch(Tree=simplify(merge_2), Path=Slider(0, range=0..10), MaintainPaths=True)
unflatten_tree = UnflattenTree(Tree=merge_2, Guide=boundary_surfaces_2)

area_2 = Area(Geometry=merge_2)  # -> Area, Centroid
mesh_closest_point_2 = MeshClosestPoint(Point=area_2.Centroid, Mesh=import_image)  # -> Point, Index, Parameter
mesh_eval_2 = MeshEval(Mesh=import_image, Parameter=mesh_closest_point_2.Parameter)  # -> Point, Normal, Colour
colour_2 = Colour(simplify(mesh_eval_2.Colour))
text_split_2 = TextSplit(Text=colour_2, Separators=",")
dispatch_3 = Dispatch(List=tree_branch, DispatchPattern=way_of_working)  # -> ListA, ListB

clean_tree = CleanTree(RemoveNulls=True, RemoveInvalid=True, RemoveEmpty=True, Tree=text_split_2)
panel_2 = Panel(clean_tree)
area_3 = Area(Geometry=dispatch_3.ListA)  # -> Area, Centroid

# ----
# points to be divided to surfaces
point = Point(area_3.Centroid)

pull_point = PullPoint(Point=flatten(point), Geometry=simplify(graft(output_panels)), ClosestOnly=True)  # -> ClosestPoint, simplify(Distance)
smaller_than = SmallerThan(FirstNumber=pull_point.Distance, SecondNumber="0.0001")  # -> SmallerThan, OrEqualTo
dispatch_4 = Dispatch(List=simplify(pull_point.ClosestPoint), DispatchPattern=smaller_than.SmallerThan)  # -> ListA, ListB

output_points_divided_to_surfaces = Geometry(dispatch_4.ListA)
flip_matrix = FlipMatrix(Data=output_points_divided_to_surfaces)
list_item_4 = ListItem(List=flip_matrix, Index=0, Wrap=True)

k_means_clustering_2 = KMeansClustering(TrainingInputs=clean_tree, OfClusters=amount_of_colors_for_colors, RandomSeed=3)  # -> Result, Likelihood, Centroids
list_item_5 = ListItem(List=k_means_clustering_2.Centroids, Index=0, Wrap=True)  # -> Item, Item1, Item2
colour_rgb_2 = ColourRGB(Alpha=255, Red=list_item_5.Item, Green=list_item_5.Item1, Blue=list_item_5.Item2)  # -> flatten(Colour)

list_item_6 = ListItem(List=k_means_clustering_2.Centroids, Index=0, Wrap=True)  # -> Item, Item1, Item2
colour_rgb_3 = ColourRGB(Alpha=255, Red=list_item_6.Item, Green=list_item_6.Item1, Blue=list_item_6.Item2)  # -> flatten(Colour)
list_item_7 = ListItem(List=colour_rgb_3, Index=k_means_clustering_2.Result, Wrap=True)

dispatch_5 = Dispatch(List=list_item_7, DispatchPattern=way_of_working)  # -> ListA, ListB

unflatten_tree_2 = UnflattenTree(Tree=dispatch_5.ListA, Guide=boundary_surfaces_2)
create_set = CreateSet(List=unflatten_tree_2)  # -> Set, Map

custom_preview = CustomPreview(Geometry=dispatch.ListB, Material=dispatch_2.ListB)
custom_preview_2 = CustomPreview(Geometry=dispatch_3.ListA, Material=dispatch_5.ListA)

member_index = MemberIndex(Set=unflatten_tree_2, Member=create_set.Set)  # -> Index, Count
tree_statistics = TreeStatistics(Tree=member_index.Index)  # -> simplify(Paths), Length, Count
tree_branch_2 = TreeBranch(Tree=simplify(unflatten_tree), Path=tree_statistics.Paths, MaintainPaths=True)
