# Grasshopper definition 12 image+dividing 2.gh (Grasshopper 1.0.7)
# plug-ins: Squid (ShapeDiver Edition), LunchBoxML, LunchBox, Kangaroo2 Components, Parakeet

panel = Panel("C:\Users\ewama\Documents\GitHub\hgh\assets\image library\0536e7fafbae969a42e305ac12c39886.jpg")

read = Read(Path=panel)  # -> Bitmap, Bounds
dimensions = Dimensions(Surface=read.Bounds)  # -> UDimension, VDimension

# ---- group: inputy
cell_selection = Slider(0, range=0..1)
amount_of_colors_for_big_panels = Slider(8, range=2..20)
amount_of_colors_for_colors = Slider(8, range=2..20)
way_of_working = BooleanToggle(True)
number_slider = Slider(20, range=0..100)
amount_of_color_pickers = Slider(12, range=0..20)

# ----
geometry = Geometry(read.Bounds)

# ----
# area to be divided
value_list = ValueList({"diamond panels": 1, "rectangle": 2, "triangle": 3, "bricks": 4}, selected="bricks")
number_slider_2 = Slider(52.8, range=0..100)
surface = Surface(geometry)

dimensions_2 = Dimensions(Surface=surface)  # -> UDimension, VDimension
division = Division(A=dimensions_2.UDimension, B=Slider(56.63, range=0..100))
division_2 = Division(A=dimensions_2.VDimension, B=number_slider_2)
round = Round(Number=division)  # -> Nearest, Floor, Ceiling
round_2 = Round(Number=division_2)  # -> Nearest, Floor, Ceiling

# ----
# dividing to panels
stream_gate = StreamGate(Stream=surface, Gate=value_list)  # -> Target0, Target1, Target2, Target3, Target4
multiplication = Multiplication(A=round.Floor, B=2)
multiplication_2 = Multiplication(A=round_2.Floor, B=2)
diamond_panels = DiamondPanels(Surface=stream_gate.Target1, UDivisions=multiplication, VDivisions=multiplication_2)  # -> DiamondPanels, TriPanels
hexagon_cells = HexagonCells(Surface=stream_gate.Target0, UDivisions=multiplication, VDivisions=multiplication_2, TParameter=0.25)  # -> HexagonCells, Centers
quad_panels = QuadPanels(Surface=stream_gate.Target2, UDivisions=round.Floor, VDivisions=round_2.Floor)
triangular_panels_a = TriangularPanelsA(Surface=stream_gate.Target3, UDivisions=round.Floor, VDivisions=round_2.Floor)
brick_type_a = BrickTypeA(BaseSurface=stream_gate.Target4, UCount=round.Floor, VCount=round_2.Floor, OffsetDistance=0)
boundary_surfaces = BoundarySurfaces(Edges=brick_type_a)
merge = Merge(
    Data1=hexagon_cells.HexagonCells,
    Data2=[diamond_panels.DiamondPanels, diamond_panels.TriPanels],
    Data3=quad_panels,
    Data4=triangular_panels_a,
    Data5=flatten(boundary_surfaces))  # -> simplify(Result)

output_panels = Geometry(merge)

# ----
# area to be divided
value_list_2 = ValueList({"hexagonal": 0, "diamond": 1, "rectangle": 2, "triangle": 3, "bricks": 4}, selected="bricks")
number_slider_3 = Slider(5, range=1..100)
number_slider_4 = Slider(3, range=1..100)
surface_2 = Surface(output_panels)

# ----
# if diamond or triangle than it has to be triangulation?
panel_2 = Panel("1")
equality = Equality(FirstNumber=value_list, SecondNumber=panel_2)  # -> Equality, Inequality
equality_2 = Equality(FirstNumber=value_list, SecondNumber="3")  # -> Equality, Inequality
gate_or = GateOr(A=equality.Equality, B=equality_2.Equality)
pick_n_choose = PickNChoose(Pattern=gate_or, Stream0=value_list_2, Stream1="3")

brep_edges = BrepEdges(Brep=output_panels)  # -> Naked, Interior, NonManifold

# ----
# dividing to cells
stream_gate_2 = StreamGate(Stream=surface_2, Gate=pick_n_choose)  # -> Target0, Target1, Target2, Target3, Target4
division_3 = Division(A=number_slider_2, B=number_slider_3)
mesh = Mesh(stream_gate_2.Target3)
diamond_panels_2 = DiamondPanels(Surface=stream_gate_2.Target1, UDivisions=number_slider_3, VDivisions=number_slider_4)  # -> DiamondPanels, TriPanels
quad_panels_2 = QuadPanels(Surface=stream_gate_2.Target2, UDivisions=number_slider_3, VDivisions=number_slider_4)
hexagon_cells_2 = HexagonCells(Surface=stream_gate_2.Target0, UDivisions=number_slider_3, VDivisions=number_slider_4, TParameter=0.25)  # -> HexagonCells, Centers
triremesh = TriRemesh(Geometry=mesh, Length=division_3, Iterations=25)  # -> Triangulation, Dual, Creases
brick_type_a_2 = BrickTypeA(BaseSurface=stream_gate_2.Target4, UCount=number_slider_3, VCount=number_slider_4, OffsetDistance=0)
boundary_surfaces_2 = BoundarySurfaces(Edges=brick_type_a_2)
mesh_to_nurbs = MeshToNurbs(Mesh=triremesh.Triangulation)  # -> QuadrangularSurfaces, TriangularSurfaces
merge_2 = Merge(
    Data1=hexagon_cells_2.HexagonCells,
    Data2=[diamond_panels_2.DiamondPanels, diamond_panels_2.TriPanels],
    Data3=quad_panels_2,
    Data4=mesh_to_nurbs.TriangularSurfaces,
    Data5=boundary_surfaces_2)  # -> simplify(flatten(Result))

pattern_hatch = PatternHatch(Pattern=0, Scale=1, Angle=0)
deconstruct_brep = DeconstructBrep(Brep=merge_2)  # -> Faces, Edges, Vertices

division_4 = Division(A=dimensions.UDimension, B=number_slider)
construct_domain² = ConstructDomain²(UMin=0, UMax=1, VMin=0, VMax=1)
division_5 = Division(A=dimensions.VDimension, B=division_4)
divide_domain² = DivideDomain²(Domain=construct_domain², UCount=number_slider, VCount=division_5)
isotrim = Isotrim(Surface=reparameterize(read.Bounds), Domain=divide_domain²)
list_length = ListLength(List=isotrim)
import_image = ImportImage(File=panel)
remap_numbers = RemapNumbers(Value=cell_selection, Source=Domain(0, 1), Target=list_length)  # -> Mapped, Clipped
list_item = ListItem(List=isotrim, Index=remap_numbers.Mapped, Wrap=True)
construct_domain²_2 = ConstructDomain²(UMin=0, UMax=1, VMin=0, VMax=1)
divide_domain²_2 = DivideDomain²(Domain=construct_domain²_2, UCount=amount_of_color_pickers, VCount=amount_of_color_pickers)
surface_3 = Surface(list_item)
isotrim_2 = Isotrim(Surface=reparameterize(graft(surface_3)), Domain=divide_domain²_2)
area = Area(Geometry=merge_2)  # -> Area, Centroid
mesh_closest_point = MeshClosestPoint(Point=area.Centroid, Mesh=import_image)  # -> Point, Index, Parameter
mesh_eval = MeshEval(Mesh=import_image, Parameter=mesh_closest_point.Parameter)  # -> Point, Normal, Colour
colour = Colour(simplify(mesh_eval.Colour))
text_split = TextSplit(Text=colour, Separators=",")
dispatch = Dispatch(List=merge_2, DispatchPattern=way_of_working)  # -> ListA, ListB

clean_tree = CleanTree(RemoveNulls=True, RemoveInvalid=True, RemoveEmpty=True, Tree=text_split)
panel_3 = Panel(clean_tree)
area_2 = Area(Geometry=dispatch.ListA)  # -> Area, Centroid

# ----
# points to be divided to surfaces
point = Point(area_2.Centroid)

pull_point = PullPoint(Point=flatten(point), Geometry=simplify(graft(output_panels)), ClosestOnly=True)  # -> ClosestPoint, simplify(Distance)
smaller_than = SmallerThan(FirstNumber=pull_point.Distance, SecondNumber="0.0001")  # -> SmallerThan, OrEqualTo
dispatch_2 = Dispatch(List=simplify(pull_point.ClosestPoint), DispatchPattern=smaller_than.SmallerThan)  # -> ListA, ListB

output_points_divided_to_surfaces = Geometry(dispatch_2.ListA)
flip_matrix = FlipMatrix(Data=output_points_divided_to_surfaces)
list_item_2 = ListItem(List=flip_matrix, Index=0, Wrap=True)

k_means_clustering = KMeansClustering(TrainingInputs=clean_tree, OfClusters=amount_of_colors_for_colors, RandomSeed=3)  # -> Result, Likelihood, Centroids
list_item_3 = ListItem(List=k_means_clustering.Centroids, Index=0, Wrap=True)  # -> Item, Item1, Item2
colour_rgb = ColourRGB(Alpha=255, Red=list_item_3.Item, Green=list_item_3.Item1, Blue=list_item_3.Item2)  # -> flatten(Colour)

list_item_4 = ListItem(List=k_means_clustering.Centroids, Index=0, Wrap=True)  # -> Item, Item1, Item2
colour_rgb_2 = ColourRGB(Alpha=255, Red=list_item_4.Item, Green=list_item_4.Item1, Blue=list_item_4.Item2)  # -> flatten(Colour)
list_item_5 = ListItem(List=colour_rgb_2, Index=k_means_clustering.Result, Wrap=True)

dispatch_3 = Dispatch(List=list_item_5, DispatchPattern=way_of_working)  # -> ListA, ListB

custom_preview = CustomPreview(Geometry=dispatch.ListA, Material=dispatch_3.ListA)
custom_preview_2 = CustomPreview(Geometry=[brep_edges.Naked, deconstruct_brep.Edges], Material=ColourSwatch(SwatchColor=RGB(5, 5, 5)))
custom_preview_3 = CustomPreview(Geometry=deconstruct_brep.Edges, Material=ColourSwatch(SwatchColor=RGB(102, 102, 102)))
