# Grasshopper definition 12 image+dividing 2_mh.gh (Grasshopper 1.0.7)
# plug-ins: Squid (ShapeDiver Edition), LunchBoxML, LunchBox, Kangaroo2 Components, Parakeet

panel = Panel("C:\Users\marty\Documents\hgh\assets\5ff41e5c643c2225fbb472a6dd0285a3.jpg")

read = Read(Path=panel)  # -> Bitmap, Bounds
dimensions = Dimensions(Surface=read.Bounds)  # -> UDimension, VDimension

# ---- group: inputy
way_of_working = BooleanToggle(True)
number_slider = Slider(20, range=0..100)
cell_selection = Slider(0, range=0..1)
amount_of_colors_for_big_panels = Slider(8, range=2..20)
amount_of_color_pickers = Slider(12, range=0..20)
amount_of_colors_for_colors = Slider(8, range=2..20)

# ----
geometry = Geometry(read.Bounds)

# ----
# area to be divided
value_list = ValueList({"diamond panels": 1, "rectangle": 2, "triangle": 3, "bricks": 4}, selected="diamond panels")
number_slider_2 = Slider(7, range=1..100)
number_slider_3 = Slider(3, range=1..100)
surface = Surface(geometry)

number_slider_4 = Slider(100, range=0..100)
dimensions_2 = Dimensions(Surface=surface)  # -> UDimension, VDimension
division = Division(A=dimensions_2.UDimension, B=Slider(56.63, range=0..100))
division_2 = Division(A=dimensions_2.VDimension, B=number_slider_4)
round = Round(Number=division)  # -> Nearest, Floor, Ceiling
round_2 = Round(Number=division_2)  # -> Nearest, Floor, Ceiling

division_3 = Division(A=dimensions_2.UDimension, B=round.Floor)
division_4 = Division(A=dimensions_2.VDimension, B=round_2.Floor)

# ----
# dividing to panels
stream_gate = StreamGate(Stream=surface, Gate=value_list)  # -> Target0, Target1, Target2, Target3, Target4
multiplication = Multiplication(A=round.Floor, B=2)
multiplication_2 = Multiplication(A=round_2.Floor, B=2)
diamond_panels = DiamondPanels(Surface=stream_gate.Target1, UDivisions=multiplication, VDivisions=multiplication_2)  # -> DiamondPanels, TriPanels
hexagon_cells = HexagonCells(Surface=stream_gate.Target0, UDivisions=multiplication, VDivisions=multiplication_2, TParameter=0.25)  # -> HexagonCells, Centers
quad_panels = QuadPanels(Surface=stream_gate.Target2, UDivisions=round.Floor, VDivisions=round_2.Floor)
triangular_panels_a = TriangularPanelsA(Surface=stream_gate.Target3, UDivisions=round.Floor, VDivisions=round_2.Floor)
brick_type_a = BrickTypeA(BaseSurface=stream_gate.Target4, UCount=round.Floor, VCount=round_2.Floor, OffsetDistance=0)
boundary_surfaces = BoundarySurfaces(Edges=brick_type_a)
merge = Merge(
    Data1=hexagon_cells.HexagonCells,
    Data2=[diamond_panels.DiamondPanels, diamond_panels.TriPanels],
    Data3=quad_panels,
    Data4=triangular_panels_a,
    Data5=flatten(boundary_surfaces))  # -> simplify(Result)

output_panels = Geometry(merge)

# ----
# area to be divided
value_list_2 = ValueList({"hexagonal": 0, "diamond": 1, "rectangle": 2, "triangle": 3, "bricks": 4}, selected="triangle")
number_slider_5 = Slider(5, range=1..100)
number_slider_6 = Slider(3, range=1..100)
surface_2 = Surface(output_panels)

# ----
# if diamond or triangle than it has to be triangulation?
panel_2 = Panel("1")
equality = Equality(FirstNumber=value_list, SecondNumber=panel_2)  # -> Equality, Inequality
equality_2 = Equality(FirstNumber=value_list, SecondNumber="3")  # -> Equality, Inequality
gate_or = GateOr(A=equality.Equality, B=equality_2.Equality)
pick_n_choose = PickNChoose(Pattern=gate_or, Stream0=value_list_2, Stream1="3")

brep_edges = BrepEdges(Brep=output_panels)  # -> Naked, Interior, NonManifold
bounding_box = BoundingBox(Content=output_panels, Plane=PlaneXY(0, 0, 0))  # -> Box, Box_2
join_curves = JoinCurves(Curves=brep_edges.Naked, Preserve=False)  # -> simplify(Curves)
rectangle = Rectangle(bounding_box.Box)
discontinuity = Discontinuity(Curve=rectangle, Level=1)  # -> simplify(Points), Parameters
list_item = ListItem(List=discontinuity.Points, Index=0, Wrap=True)
xy_plane = XYPlane(Origin=list_item)
truncated_square = TruncatedSquare(Plane=xy_plane, Size=Slider(9, range=0..10), ExtendX=4, ExtendY=4)
fracture_pattern_a = FracturePatternA(
    BasePlane=xy_plane,
    X=division_3,
    Y=division_4,
    A=0.6,
    G=2,
    Seed=Slider(44, range=0..100),
    Iteration=Slider(4, range=0..10),
    Tolerance=1)
path_mapper = PathMapper(fracture_pattern_a, source="{A;B}", target="{A}")
brep_edges_2 = BrepEdges(Brep=path_mapper)  # -> Naked, Interior, NonManifold
join_curves_2 = JoinCurves(Curves=brep_edges_2.Naked, Preserve=False)  # -> simplify(Curves)
path_mapper_2 = PathMapper(join_curves_2, source="{A;B}", target="{A}")
curve_curve = CurveCurve(CurveA=simplify(join_curves), CurveB=path_mapper_2)  # -> Points, ParamsA, simplify(ParamsB)
shatter = Shatter(Curve=join_curves_2, Parameters=curve_curve.ParamsB)  # -> reparameterize(simplify(Segments))
evaluate_curve = EvaluateCurve(Curve=shatter, Parameter="0.5")  # -> Point, Tangent, Angle
path_mapper_3 = PathMapper(shatter, source="{A;B}", target="{A}")
path_mapper_4 = PathMapper(evaluate_curve.Point, source="{A;B}", target="{A}")
point_in_curve = PointInCurve(Point=path_mapper_4, Curve=join_curves)  # -> Relationship, Point
cull_pattern = CullPattern(List=path_mapper_3, CullPattern=point_in_curve.Relationship)
sort_duplicate_curves = SortDuplicateCurves(Curves=cull_pattern)  # -> UniqueCurves, Indices
surface_split = SurfaceSplit(Surface=simplify(graft(output_panels)), Curves=[join_curves, sort_duplicate_curves.UniqueCurves])  # -> flatten(Fragments)
clean_tree = CleanTree(RemoveNulls=True, RemoveInvalid=True, RemoveEmpty=False, Tree=surface_split)
list_item_2 = ListItem(List=clean_tree, Index=0, Wrap=True)

division_5 = Division(A=dimensions.UDimension, B=number_slider)
construct_domain² = ConstructDomain²(UMin=0, UMax=1, VMin=0, VMax=1)
division_6 = Division(A=dimensions.VDimension, B=division_5)
divide_domain² = DivideDomain²(Domain=construct_domain², UCount=number_slider, VCount=division_6)
isotrim = Isotrim(Surface=reparameterize(read.Bounds), Domain=divide_domain²)
list_length = ListLength(List=isotrim)
import_image = ImportImage(File=panel)
remap_numbers = RemapNumbers(Value=cell_selection, Source=Domain(0, 1), Target=list_length)  # -> Mapped, Clipped
list_item_3 = ListItem(List=isotrim, Index=remap_numbers.Mapped, Wrap=True)
construct_domain²_2 = ConstructDomain²(UMin=0, UMax=1, VMin=0, VMax=1)
divide_domain²_2 = DivideDomain²(Domain=construct_domain²_2, UCount=amount_of_color_pickers, VCount=amount_of_color_pickers)
surface_3 = Surface(list_item_3)
isotrim_2 = Isotrim(Surface=reparameterize(graft(surface_3)), Domain=divide_domain²_2)
area = Area(Geometry=clean_tree)  # -> Area, Centroid
mesh_closest_point = MeshClosestPoint(Point=area.Centroid, Mesh=import_image)  # -> Point, Index, Parameter
mesh_eval = MeshEval(Mesh=import_image, Parameter=mesh_closest_point.Parameter)  # -> Point, Normal, Colour
colour = Colour(simplify(mesh_eval.Colour))
text_split = TextSplit(Text=colour, Separators=",")
dispatch = Dispatch(List=clean_tree, DispatchPattern=way_of_working)  # -> ListA, ListB

clean_tree_2 = CleanTree(RemoveNulls=True, RemoveInvalid=True, RemoveEmpty=True, Tree=text_split)
area_2 = Area(Geometry=dispatch.ListA)  # -> Area, Centroid

# ----
# points to be divided to surfaces
point = Point(area_2.Centroid)

list_item_4 = ListItem(List=dispatch.ListA, Index=Slider(762, range=0..2000), Wrap=True)

pull_point = PullPoint(Point=flatten(point), Geometry=simplify(graft(output_panels)), ClosestOnly=True)  # -> ClosestPoint, simplify(Distance)
smaller_than = SmallerThan(FirstNumber=pull_point.Distance, SecondNumber="0.0001")  # -> SmallerThan, OrEqualTo
dispatch_2 = Dispatch(List=simplify(pull_point.ClosestPoint), DispatchPattern=smaller_than.SmallerThan)  # -> ListA, ListB

output_points_divided_to_surfaces = Geometry(dispatch_2.ListA)
flip_matrix = FlipMatrix(Data=output_points_divided_to_surfaces)
list_item_5 = ListItem(List=flip_matrix, Index=0, Wrap=True)

# ----
# dividing to cells
stream_gate_2 = StreamGate(Stream=surface_2, Gate=pick_n_choose)  # -> Target0, Target1, Target2, Target3, Target4
division_7 = Division(A=number_slider_4, B=number_slider_5)
mesh = Mesh(stream_gate_2.Target3)
diamond_panels_2 = DiamondPanels(Surface=stream_gate_2.Target1, UDivisions=number_slider_5, VDivisions=number_slider_6)  # -> DiamondPanels, TriPanels
quad_panels_2 = QuadPanels(Surface=stream_gate_2.Target2, UDivisions=number_slider_5, VDivisions=number_slider_6)
hexagon_cells_2 = HexagonCells(Surface=stream_gate_2.Target0, UDivisions=number_slider_5, VDivisions=number_slider_6, TParameter=0.25)  # -> HexagonCells, Centers
triremesh = TriRemesh(Geometry=mesh, Length=division_7, Iterations=25)  # -> Triangulation, Dual, Creases
brick_type_a_2 = BrickTypeA(BaseSurface=stream_gate_2.Target4, UCount=number_slider_5, VCount=number_slider_6, OffsetDistance=0)
boundary_surfaces_2 = BoundarySurfaces(Edges=brick_type_a_2)
mesh_to_nurbs = MeshToNurbs(Mesh=triremesh.Triangulation)  # -> QuadrangularSurfaces, TriangularSurfaces

boundary_surfaces_3 = BoundarySurfaces(Edges=hexagon_cells_2.HexagonCells)

merge_2 = Merge(
    Data1=boundary_surfaces_3,
    Data2=[diamond_panels_2.DiamondPanels, diamond_panels_2.TriPanels],
    Data3=quad_panels_2,
    Data4=mesh_to_nurbs.TriangularSurfaces,
    Data5=boundary_surfaces_2)  # -> simplify(flatten(Result))

k_means_clustering = KMeansClustering(TrainingInputs=clean_tree_2, OfClusters=amount_of_colors_for_colors, RandomSeed=3)  # -> Result, Likelihood, Centroids

list_item_6 = ListItem(List=k_means_clustering.Centroids, Index=0, Wrap=True)  # -> Item, Item1, Item2
colour_rgb = ColourRGB(Alpha=255, Red=list_item_6.Item, Green=list_item_6.Item1, Blue=list_item_6.Item2)  # -> flatten(Colour)
list_item_7 = ListItem(List=colour_rgb, Index=k_means_clustering.Result, Wrap=True)
panel_3 = Panel(list_item_7)

dispatch_3 = Dispatch(List=list_item_7, DispatchPattern=way_of_working)  # -> ListA, ListB

unflatten_tree = UnflattenTree(Tree=clean_tree, Guide=dispatch_3.ListA)
panel_4 = Panel(dispatch_3.ListA)
custom_preview = CustomPreview(Geometry=dispatch.ListA, Material=dispatch_3.ListA)
