# Grasshopper definition Kwantyzacja_kolorow_v1.gh (Grasshopper 1.0.7)
# plug-ins: Squid (ShapeDiver Edition), LunchBoxML

resolution = Slider(0.03, range=0..1)
liczba_kolorow = Slider(9, range=2..20)

read = Read(Path="C:\Users\mateu\Documents\GitHub\hgh\TEST_IMAGE.jpg")  # -> Bitmap, Bounds

# ---- group: siatka
dimensions = Dimensions(Surface=read.Bounds)  # -> UDimension, VDimension
multiplication = Multiplication(A=dimensions.VDimension, B=resolution)
multiplication_2 = Multiplication(A=dimensions.UDimension, B=resolution)
division = Division(A=dimensions.VDimension, B=multiplication)
plane_surface = PlaneSurface(Plane=PlaneXY(0, 0, 0), XSize=dimensions.UDimension, YSize=dimensions.VDimension)
division_2 = Division(A=dimensions.UDimension, B=multiplication_2)
construct_domain² = ConstructDomain²(UMin=0, UMax=1, VMin=0, VMax=1)
remap_numbers = RemapNumbers(Value=multiplication, Source=dimensions.VDimension, Target=Domain(0, 1))  # -> Mapped, Clipped
remap_numbers_2 = RemapNumbers(Value=multiplication_2, Source=dimensions.UDimension, Target=Domain(0, 1))  # -> Mapped, Clipped
divide_domain² = DivideDomain²(Domain=construct_domain², UCount=division_2, VCount=division)
rectangular = Rectangular(Plane=PlaneXY(0, 0, 0), SizeX=remap_numbers_2.Mapped, SizeY=remap_numbers.Mapped, ExtentX=division_2, ExtentY=division)  # -> Cells, Points
isotrim = Isotrim(Surface=reparameterize(plane_surface), Domain=divide_domain²)

# ---- group: samplowanie siatki
area = Area(Geometry=rectangular.Cells)  # -> Area, Centroid
image_sampler = ImageSampler(
    area.Centroid,
    FilePath="C:\Users\mateu\Documents\GitHub\hgh\TEST_IMAGE.jpg",
    Filter="Colour",
    Interpolate=False,
    Umax=1,
    Umin=0,
    Vmax=1,
    Vmin=0,
    Wrap=1)

# ---- group: kwantyzacja
text_split = TextSplit(Text=flatten(image_sampler), Separators=",")
k_means_clustering = KMeansClustering(TrainingInputs=text_split, OfClusters=liczba_kolorow, RandomSeed=3)  # -> Result, Likelihood, Centroids
list_item = ListItem(List=k_means_clustering.Centroids, Index=0, Wrap=True)  # -> Item, Item1, Item2
colour_rgb = ColourRGB(Alpha=255, Red=list_item.Item, Green=list_item.Item1, Blue=list_item.Item2)  # -> flatten(Colour)
list_item_2 = ListItem(List=colour_rgb, Index=k_means_clustering.Result, Wrap=True)

# ----
custom_preview = CustomPreview(Geometry=isotrim, Material=list_item_2)
