# Grasshopper definition Mateusz.gh (Grasshopper 1.0.7)
# plug-ins: BitmapPlus, Squid (ShapeDiver Edition), LunchBox, Firefly.X, LunchBoxML

panel = Panel("C:\Users\mateu\Documents\GitHub\hgh\TEST_IMAGE.jpg")
construct_domain = ConstructDomain(DomainStart=Slider(0, range=0..1), DomainEnd=Slider(1, range=0..1))
construct_domain_2 = ConstructDomain(DomainStart=Slider(0, range=0..1), DomainEnd=Slider(0.65, range=0..1))
construct_domain_3 = ConstructDomain(DomainStart=Slider(0, range=0..1), DomainEnd=Slider(0.71, range=0..1))
read = Read(Path=panel)  # -> Bitmap, Bounds
open_bitmap = OpenBitmap(Load=Toggle(True))
dimensions = Dimensions(Surface=read.Bounds)  # -> UDimension, VDimension
bitmap_properties = BitmapProperties(Image=open_bitmap)  # -> Boundary, Width, Height, HorizontalResolution, VerticalResolution, Format
number_slider = Slider(0.01, range=0..1)
division = Division(A=bitmap_properties.Width, B="200")
round = Round(Number=division)  # -> Nearest, Floor, Ceiling
multiplication = Multiplication(A=dimensions.UDimension, B=number_slider)
multiplication_2 = Multiplication(A=dimensions.VDimension, B=number_slider)
division_2 = Division(A=bitmap_properties.Height, B=round.Nearest)
division_3 = Division(A=dimensions.UDimension, B=multiplication)
division_4 = Division(A=dimensions.VDimension, B=multiplication_2)
division_5 = Division(A=bitmap_properties.Width, B=round.Nearest)
remap_numbers = RemapNumbers(Value=multiplication_2, Source=dimensions.VDimension, Target=Domain(0, 1))  # -> Mapped, Clipped
remap_numbers_2 = RemapNumbers(Value=multiplication, Source=dimensions.UDimension, Target=Domain(0, 1))  # -> Mapped, Clipped
number_slider_2 = Slider(18, range=0..100)
number_slider_3 = Slider(100, range=0..100)
resize_image = ResizeImage(Image=open_bitmap, Mode=0, Width=division_5, Height=division_2)
read_2 = Read()  # -> Bitmap, Bounds
open_bitmap_2 = OpenBitmap(FilePath="C:\Users\mateu\Documents\GitHub\hgh\TEST_IMAGE.jpg", Load=Toggle(True))
load_bitmap = LoadBitmap()
prev_image = PrevImage()
rectangular = Rectangular(Plane=PlaneXY(0, 0, 0), SizeX=remap_numbers_2.Mapped, SizeY=remap_numbers.Mapped, ExtentX=division_3, ExtentY=division_4)  # -> Cells, Points
division_6 = Division(B=Slider(16, range=0..30))
ghpython_script = GhPythonScript(RGB_In=ColourSwatch(SwatchColor=RGB(176, 25, 25)))  # -> C, M, Y, K; inputs RGB_In: list
# ---------- ghpython_script: Python ----------
# Wejście: RGB_In (Lista kolorów z Image Samplera)
# Wyjścia: C, M, Y, K

C, M, Y, K = [], [], [], []

for col in RGB_In:
    # Zamiana zakresu 0-255 na 0.0-1.0
    r = col.R / 255.0
    g = col.G / 255.0
    b = col.B / 255.0
    
    # Obliczanie czerni (K)
    k = 1.0 - max(r, g, b)
    
    # Obliczanie C, M, Y z zabezpieczeniem przed dzieleniem przez zero
    if k == 1.0:
        c = 0.0
        m = 0.0
        y = 0.0
    else:
        c = (1.0 - r - k) / (1.0 - k)
        m = (1.0 - g - k) / (1.0 - k)
        y = (1.0 - b - k) / (1.0 - k)
        
    # Dodawanie wyników do list (wartości od 0.0 do 1.0, opcjonalnie * 100 dla procentów)
    C.append(c)
    M.append(m)
    Y.append(y)
    K.append(k)
# ---------- end ghpython_script ----------
division_7 = Division(B=Slider(16, range=0..30))
grid_structure = GridStructure(Surface=read_2.Bounds, UDivisions=number_slider_2, VDivisions=number_slider_3)  # -> StructureLines, StructureNodes
dimensions_2 = Dimensions(Surface=read_2.Bounds)  # -> UDimension, VDimension
colour_cmyk = ColourCMYK(Cyan=ghpython_script.C, Magenta=ghpython_script.M, Yellow=ghpython_script.Y, Key=ghpython_script.K)
area = Area(Geometry=rectangular.Cells)  # -> Area, Centroid
bitmap_sampler = BitmapSampler(
    BitmapToModify=load_bitmap,
    PointToSample=grid_structure.StructureNodes,
    BitmapToModify_2=load_bitmap,
    PointToSample_2=grid_structure.StructureNodes,
    bitmap_filter=0)  # -> SampledImageData, SampledImageData_2
division_8 = Division(A=dimensions_2.UDimension, B=number_slider_2)
division_9 = Division(A=dimensions_2.VDimension, B=number_slider_3)
includes = Includes(Domain=Domain(0, 1))  # -> Includes, Deviation
division_10 = Division(A=division_9, B=2)
division_11 = Division(A=division_8, B=2)
scale = Scale(Geometry=rectangular.Cells, Center=Point(0, 0, 0), Factor="10")  # -> Geometry, Transform
load_bitmap_2 = LoadBitmap(FilePathToImageLocation=panel)
construct_domain_4 = ConstructDomain(DomainStart=expr("x*-1", division_11), DomainEnd=division_11)
construct_domain_5 = ConstructDomain(DomainStart=expr("x*-1", division_10), DomainEnd=division_10)
text_split = TextSplit(Text=bitmap_sampler.SampledImageData_2, Separators=",")
image_sampler = ImageSampler(
    area.Centroid,
    FilePath="C:\Users\mateu\Documents\GitHub\hgh\TEST_IMAGE.jpg",
    Filter="Colour",
    Interpolate=False,
    Umax=1,
    Umin=0,
    Vmax=1,
    Vmin=0,
    Wrap=1)
rectangle = Rectangle(Plane=grid_structure.StructureNodes, XSize=construct_domain_4, YSize=construct_domain_5, Radius=0)  # -> Rectangle, Length
similarity = Similarity(FirstNumber=text_split, Threshold=0.1)  # -> Similarity, AbsoluteDifference
edge_detection = EdgeDetection(BitmapToModify=load_bitmap_2, Threshold=1, EdgeSelection=2)
boundary_surfaces = BoundarySurfaces(Edges=scale.Geometry)
text_split_2 = TextSplit(Text=flatten(image_sampler), Separators=",")
surface = Surface(rectangle.Rectangle)
custom_preview = CustomPreview(Geometry=surface, Material=bitmap_sampler.SampledImageData_2)
k_means_clustering = KMeansClustering(TrainingInputs=text_split_2, OfClusters=Slider(4, range=2..20), RandomSeed=3)  # -> Result, Likelihood, Centroids
bitmap_tracer = BitmapTracer(
    BitmapToModify=edge_detection,
    XIntervalForFieldLines=Domain(0, 24),
    XIntervalForFieldLines_2=Domain(0, 18),
    NumberOfSeeds=100,
    Reset=False)
list_item = ListItem(List=k_means_clustering.Centroids, Index=0, Wrap=True)  # -> Item, Item1, Item2
colour_rgb = ColourRGB(Alpha=255, Red=list_item.Item, Green=list_item.Item1, Blue=list_item.Item2)  # -> flatten(Colour)
list_item_2 = ListItem(List=colour_rgb, Index=k_means_clustering.Result, Wrap=True)
unflatten_tree = UnflattenTree(Tree=list_item_2, Guide=rectangular.Cells)
custom_preview_2 = CustomPreview(Geometry=boundary_surfaces, Material=unflatten_tree)
