# Grasshopper definition Model_test.gh (Grasshopper 1.0.8)
# plug-ins: Speckle.Connector.Grasshopper

panel = Panel("https://app.speckle.systems/projects/566e6518c0/models/df97a50075/versions")
speckle_model_url = SpeckleModelURL(SpeckleUrl=panel, Server="https://app.speckle.systems", User="FDB1F9747CCB927236FC87E590B7A656")
speckle_model = SpeckleModel(
    Model="df97a50075",
    Project="566e6518c0",
    Server="https://app.speckle.systems",
    User="FDB1F9747CCB927236FC87E590B7A656",
    Workspace="1389b8e908")
brep = Brep([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])
speckle_data_object = SpeckleDataObject(Geometries=brep, HasApplicationIdParam=False, IsDesignOption=False)  # -> SpeckleDataObject, Geometries, Name, Properties, Path
create_collection = CreateCollection(SubCollection1=speckle_data_object.SpeckleDataObject, AlwaysInheritNames=False)
publish = Publish(SpeckleModel=speckle_model, Collection=create_collection)  # -> SpeckleModel, VersionID
panel_2 = Panel(publish.SpeckleModel)
