# Grasshopper definition image_sampling.gh (Grasshopper 1.0.7)
# plug-ins: Kangaroo2 Components, OpenNest, Sasquatch, LunchBox, Parakeet, Squid (ShapeDiver Edition), LunchBoxML

curve = Curve([<curve referenced from the Rhino model> x6])  # disabled
number_slider = Slider(87, range=0..100)  # disabled
curve_to_polyline = CurveToPolyline(Curve=curve, ToleranceDistance=5, ToleranceAngle=0)  # -> Polyline, Segments; disabled
surface = Surface(<surface referenced from the Rhino model>)
number_slider_2 = Slider(58, range=0..100)  # disabled
number_slider_3 = Slider(3, range=0..3)  # disabled
number_slider_4 = Slider(79, range=0..100)  # disabled
brep_edges = BrepEdges(Brep=surface)  # -> Naked, Interior, NonManifold
boolean_toggle = BooleanToggle(False)  # disabled
surface_split = SurfaceSplit(Surface=surface, Curves=curve_to_polyline.Polyline)  # -> flatten(Fragments); disabled
button = Button()  # disabled
button_2 = Button()  # disabled
surface_2 = Surface([<surface referenced from the Rhino model> x3])  # disabled
join_curves = JoinCurves(Curves=brep_edges.Naked, Preserve=False)
curve_2 = Curve(<curve referenced from the Rhino model>)  # disabled
boundary_surfaces = BoundarySurfaces(Edges=curve_2)  # disabled
duplicate_data = DuplicateData(Data=boundary_surfaces, Number=number_slider, Order=True)  # -> flatten(Data); disabled
brep_edges_2 = BrepEdges(Brep=surface_split)  # -> Naked, Interior, NonManifold; disabled
surface_border = SurfaceBorder(Surface=surface_split)  # -> flatten(OuterBorder), InnterBorder; disabled
surface_3 = Surface(join_curves)

number_slider_5 = Slider(78, range=1..100)
number_slider_6 = Slider(85, range=1..100)
value_list = ValueList({"hexagonal": 0, "diamond": 1, "rectangle": 2, "triangle": 3, "bricks": 4}, selected="bricks")

divide_surface = DivideSurface(Surface=surface, UCount=Slider(57, range=0..100), VCount=Slider(53, range=0..100))  # -> Points, Normals, Parameters
graft_tree = GraftTree(Tree=surface_border.OuterBorder, IncludeEmptyLists=True, IncludeNullItems=True)  # -> simplify(Tree); disabled
panel = Panel("C:\Users\ewama\Documents\GitHub\hgh\img\mozaika_kwantyzacja_ps.png")  # disabled
opennest = OpenNest(
    Sheets=surface_2,
    Geo=duplicate_data,
    Spacing=1,
    Placement=4,
    Tolerance=0.1,
    Rotations=4,
    Iterations=number_slider_4,
    Seed=number_slider_2,
    Reset=button_2,
    Run=button)  # -> Sheets, Geo, ID, Transform, IDS; disabled
number_slider_7 = Slider(0, range=0..100)  # disabled
number_slider_8 = Slider(250, range=100..500)  # disabled
join_curves_2 = JoinCurves(Curves=brep_edges_2.Naked, Preserve=False)  # -> flatten(Curves); disabled
image_sampler = ImageSampler(
    surface,
    FilePath="C:\Users\ewama\Documents\GitHub\hgh\img\mozaika_kwantyzacja_ps.png",
    Filter="Colour",
    Interpolate=False,
    Umax=1984,
    Umin=1,
    Vmax=1546,
    Vmin=1,
    Wrap=1)
area = Area(Geometry=surface_split)  # -> Area, Centroid; disabled
stream_gate = StreamGate(Stream=surface_3, Gate=value_list)  # -> Target0, Target1, Target2, Target3, Target4
list_item = ListItem(List=surface_split, Index=number_slider_3, Wrap=True)  # disabled
read = Read(Path=panel)  # -> Bitmap, Bounds; disabled
merge = Merge()  # disabled
pack_objects = PackObjects(X=1, Y=1, Tolerabce=0)  # -> Geo, Transformation; disabled
area_2 = Area(Geometry=curve_2)  # -> Area, Centroid; disabled
division = Division(A=area.Area, B=number_slider_8)  # disabled
dimensions = Dimensions(Surface=read.Bounds)  # -> UDimension, VDimension; disabled
number_slider_9 = Slider(0.01, range=0..1)  # disabled
diamond_panels = DiamondPanels(Surface=stream_gate.Target1, UDivisions=number_slider_5, VDivisions=number_slider_6)  # -> DiamondPanels, TriPanels
quad_panels = QuadPanels(Surface=stream_gate.Target2, UDivisions=number_slider_5, VDivisions=number_slider_6)
triangular_panels_a = TriangularPanelsA(Surface=stream_gate.Target3, UDivisions=number_slider_5, VDivisions=number_slider_6)

brick_type_a = BrickTypeA(BaseSurface=stream_gate.Target4, UCount=number_slider_5, VCount=number_slider_6, OffsetDistance=0)
boundary_surfaces_2 = BoundarySurfaces(Edges=brick_type_a)  # disabled
explode = Explode(Curve=brick_type_a, Recursive=True)  # -> Segments, Vertices
c_script = CSharpScript()  # -> out, A; inputs brep: Brep, curves: list of Curve
# ---------- c_script: C# ----------
if (!(brep.Faces[0].UnderlyingSurface() is PlaneSurface)){
    Component.AddRuntimeMessage(GH_RuntimeMessageLevel.Error, "brep.Faces[0].UnderlyingSurface() is not a planar surface");
    return;
}

Brep new_brep = new Brep();
new_brep.Append(brep);
List<Curve> boundary = new List<Curve>();

foreach (Curve curve in curves){
    boundary.Add(curve);
    new_brep.Loops.AddPlanarFaceLoop(0, Rhino.Geometry.BrepLoopType.Inner, boundary);
    boundary.Clear();
}

new_brep.Faces[0].RebuildEdges(doc.ModelAbsoluteTolerance, true, true);
new_brep.Compact();

A = new_brep;
# ---------- end c_script ----------
removeduplicatelines = RemoveDuplicateLines(Lines=flatten(explode.Segments), Tolerance=0.01)  # -> simplify(UniqueLines)
surface_split_2 = SurfaceSplit(Surface=stream_gate.Target4, Curves=removeduplicatelines)  # -> simplify(Fragments); disabled

import_image = ImportImage(File="C:\Users\ewama\Documents\GitHub\hgh\img\mozaika_kwantyzacja_ps.png", Rectangle=surface_3)
hexagon_cells = HexagonCells(Surface=stream_gate.Target0, UDivisions=number_slider_5, VDivisions=number_slider_6, TParameter=0.25)  # -> HexagonCells, Centers
populate_geometry = PopulateGeometry(Geometry=surface_split, Count=division, Seed=number_slider_7)  # disabled
panel_2 = Panel(division)  # disabled
vector_2pt = Vector2Pt(PointA=area_2.Centroid, PointB=populate_geometry, Unitize=False)  # -> Vector, Length; disabled
panel_3 = Panel(surface_split)  # disabled
number_slider_10 = Slider(183, range=0..360)  # disabled
multiplication = Multiplication(A=dimensions.UDimension, B=number_slider_9)  # disabled
multiplication_2 = Multiplication(A=dimensions.VDimension, B=number_slider_9)  # disabled
move = Move(Geometry=curve_2, Motion=vector_2pt.Vector)  # -> Geometry, Transform; disabled
area_3 = Area(Geometry=move.Geometry)  # -> Area, Centroid; disabled
division_2 = Division(A=dimensions.UDimension, B=multiplication)  # disabled
division_3 = Division(A=dimensions.VDimension, B=multiplication_2)  # disabled
remap_numbers = RemapNumbers(Value=multiplication_2, Source=dimensions.VDimension, Target=Domain(0, 1))  # -> Mapped, Clipped; disabled
remap_numbers_2 = RemapNumbers(Value=multiplication, Source=dimensions.UDimension, Target=Domain(0, 1))  # -> Mapped, Clipped; disabled
rotate = Rotate(Geometry=move.Geometry, Angle=degrees(number_slider_10), Plane=area_3.Centroid)  # -> simplify(Geometry), Transform; disabled
panel_4 = Panel(rotate.Geometry)  # disabled
rectangular = Rectangular(Plane=PlaneXY(0, 0, 0), SizeX=remap_numbers_2.Mapped, SizeY=remap_numbers.Mapped, ExtentX=division_2, ExtentY=division_3)  # -> Cells, Points; disabled
curvecollide = CurveCollide(Curves=rotate.Geometry, BasePlane=PlaneXY(0, 0, 0), Strength=1)  # -> Goal, Frames; disabled
show = Show()  # disabled
boolean_toggle_2 = BooleanToggle(False)  # disabled
area_4 = Area(Geometry=rectangular.Cells)  # -> Area, Centroid; disabled
button_3 = Button()  # disabled
merge_2 = Merge(Data1=show, Data2=curvecollide.Goal)  # disabled
panel_5 = Panel("10")  # disabled
scale = Scale(Geometry=rectangular.Cells, Center=Point(0, 0, 0), Factor=panel_5)  # -> Geometry, Transform; disabled
bouncysolver = BouncySolver(GoalObjects=merge_2, Reset=button_3, Threshold=1e-15, Tolerance=0.0001, Damping=0.99, Iterations=10, On=boolean_toggle_2)  # -> I, V, O; disabled
merge_3 = Merge(
    Data1=hexagon_cells.HexagonCells,
    Data2=diamond_panels.DiamondPanels,
    Data3=quad_panels,
    Data4=triangular_panels_a,
    Data5=flatten(surface_split_2))
image_sampler_2 = ImageSampler(
    area_4.Centroid,
    FilePath="C:\Users\ewama\Documents\GitHub\hgh\TEST_IMAGE.jpg",
    Filter="Colour",
    Interpolate=False,
    Umax=1,
    Umin=0,
    Vmax=1,
    Vmin=0,
    Wrap=1)  # disabled
geometry = Geometry(bouncysolver.V)  # disabled
area_5 = Area(Geometry=merge_3)  # -> Area, Centroid
geometry_2 = Geometry(merge_3)
panel_6 = Panel(merge_3)
number_slider_11 = Slider(4, range=2..20)  # disabled
boundary_surfaces_3 = BoundarySurfaces(Edges=scale.Geometry)  # disabled
panel_7 = Panel(",")  # disabled
text_split = TextSplit(Text=flatten(image_sampler_2), Separators=panel_7)  # disabled
mesh_closest_point = MeshClosestPoint(Point=area_5.Centroid, Mesh=import_image)  # -> Point, Index, Parameter
face_normals = FaceNormals()  # -> Centers, Normals
k_means_clustering = KMeansClustering(TrainingInputs=text_split, OfClusters=number_slider_11, RandomSeed=3)  # -> Result, Likelihood, Centroids; disabled
mesh_eval = MeshEval(Mesh=import_image, Parameter=mesh_closest_point.Parameter)  # -> Point, Normal, Colour
point_in_brep = PointInBrep(Brep=merge_3, Point=face_normals.Centers, Strict=False)  # disabled
colour = Colour(simplify(mesh_eval.Colour))
list_item_2 = ListItem(List=k_means_clustering.Centroids, Index=0, Wrap=True)  # -> Item, Item1, Item2; disabled
rgb_to_cmyk = GhPythonScript(RGB_Colors=colour)  # -> out, C, M, Y, K; inputs RGB_Colors: list of Color
# ---------- rgb_to_cmyk: Python ----------
# Input: RGB_Colors (Set to List Access and Color Type Hint)
# Outputs: C, M, Y, K

# Initialize empty lists to store the output data streams
C = []
M = []
Y = []
K = []

# Loop through every color in your incoming list
for color in RGB_Colors:
    
    # 1. Normalize RGB from 0-255 down to a 0.0 - 1.0 scale
    r = color.R / 255.0
    g = color.G / 255.0
    b = color.B / 255.0

    # 2. Calculate Black (K)
    k = 1.0 - max(r, g, b)

    # 3. Calculate Cyan, Magenta, Yellow based on Black saturation
    if k == 1.0:
        # Prevent division-by-zero errors for pure black
        c = 0.0
        m = 0.0
        y = 0.0
    else:
        c = (1.0 - r - k) / (1.0 - k)
        m = (1.0 - g - k) / (1.0 - k)
        y = (1.0 - b - k) / (1.0 - k)

    # 4. Convert values to clean percentages (0 to 100) and round to 1 decimal place
    C.append(round(c , 1))
    M.append(round(m , 1))
    Y.append(round(y , 1))
    K.append(round(k , 1))
# ---------- end rgb_to_cmyk ----------
dispatch = Dispatch(List=face_normals.Centers, DispatchPattern=point_in_brep)  # -> ListA, ListB
colour_rgb = ColourRGB(Alpha=255, Red=list_item_2.Item, Green=list_item_2.Item1, Blue=list_item_2.Item2)  # -> flatten(Colour); disabled
colour_cmyk = ColourCMYK(Cyan=rgb_to_cmyk.C, Magenta=rgb_to_cmyk.M, Yellow=rgb_to_cmyk.Y, Key=rgb_to_cmyk.K)
list_item_3 = ListItem(List=colour_rgb, Index=k_means_clustering.Result, Wrap=True)  # disabled
mesh_closest_point_2 = MeshClosestPoint(Point=dispatch.ListA, Mesh=import_image)  # -> Point, Index, Parameter
custom_preview = CustomPreview(Geometry=merge_3, Material=colour_cmyk)
unflatten_tree = UnflattenTree(Tree=list_item_3, Guide=rectangular.Cells)  # disabled
mesh_eval_2 = MeshEval(Mesh=import_image, Parameter=mesh_closest_point_2.Parameter)  # -> Point, Normal, Colour
panel_8 = Panel(unflatten_tree)  # disabled
bounds = Bounds(Numbers=point_in_brep)
custom_preview_2 = CustomPreview(Geometry=boundary_surfaces_3, Material=unflatten_tree)  # disabled
