# Grasshopper definition sort_points_by_surface.gh (Grasshopper 1.0.8)

number_slider = Slider(3, range=0..10)
series = Series(Start=0, Step=number_slider, Count=10)
rectangle = Rectangle(Plane=PlaneXY(0, 0, 0), XSize=number_slider, YSize=number_slider, Radius=0)  # -> Rectangle, Length
construct_point = ConstructPoint(XCoordinate=series, YCoordinate=graft(series), ZCoordinate=0)
surface = Surface(rectangle.Rectangle)
move = Move(Geometry=surface, Motion=construct_point)  # -> flatten(Geometry), Transform
list_length = ListLength(List=flatten(move.Geometry))
random = Random(Range=list_length, Number=list_length, Seed=2)
populate_2d = Populate2D(Region=move.Geometry, Count=Slider(7, range=1..10), Seed=random)  # -> flatten(Population)
point = Point(populate_2d)
surface_2 = Surface(move.Geometry)
