# Grasshopper definition 1234 image+dividing+extrusion+speckle.gh (Grasshopper 1.0.8)
# plug-ins: Squid (ShapeDiver Edition), Pufferfish, LunchBoxML, LunchBox, Speckle.Connector.Grasshopper

query_directory = QueryDirectory(Directory="C:\Users\model\Documents\Github\hgh\assets\image library\")  # -> graft(Directory), Directories, Files
list_item = ListItem(List=query_directory.Files, Index=Slider(10, range=0..15), Wrap=True)
file_path = FilePath(list_item)

read = Read(Path=file_path)  # -> Bitmap, Bounds
dimensions = Dimensions(Surface=read.Bounds)  # -> UDimension, VDimension

# ---- group: inputy
cell_selection = Slider(0, range=0..1)
amount_of_colors_for_big_panels = Slider(8, range=2..20)
way_of_working = BooleanToggle(False)
number_slider = Slider(20, range=0..100)
amount_of_color_pickers = Slider(12, range=0..20)
amount_of_colors_for_colors = Slider(8, range=2..20)

# ----
division = Division(A=dimensions.UDimension, B=number_slider)
construct_domain² = ConstructDomain²(UMin=0, UMax=1, VMin=0, VMax=1)
division_2 = Division(A=dimensions.VDimension, B=division)
divide_domain² = DivideDomain²(Domain=construct_domain², UCount=number_slider, VCount=division_2)
isotrim = Isotrim(Surface=reparameterize(read.Bounds), Domain=divide_domain²)
list_length = ListLength(List=isotrim)
import_image = ImportImage(File=file_path, Rectangle=read.Bounds)
remap_numbers = RemapNumbers(Value=cell_selection, Source=Domain(0, 1), Target=list_length)  # -> Mapped, Clipped
area = Area(Geometry=isotrim)  # -> Area, Centroid
list_item_2 = ListItem(List=isotrim, Index=remap_numbers.Mapped, Wrap=True)
construct_domain²_2 = ConstructDomain²(UMin=0, UMax=1, VMin=0, VMax=1)
mesh_closest_point = MeshClosestPoint(Point=area.Centroid, Mesh=import_image)  # -> Point, Index, Parameter
mesh_eval = MeshEval(Mesh=import_image, Parameter=mesh_closest_point.Parameter)  # -> Point, Normal, Colour
divide_domain²_2 = DivideDomain²(Domain=construct_domain²_2, UCount=amount_of_color_pickers, VCount=amount_of_color_pickers)
surface = Surface(list_item_2)
isotrim_2 = Isotrim(Surface=reparameterize(graft(surface)), Domain=divide_domain²_2)
colour = Colour(simplify(mesh_eval.Colour))
text_split = TextSplit(Text=flatten(colour), Separators=",")
area_2 = Area(Geometry=isotrim_2)  # -> Area, Centroid
k_means_clustering = KMeansClustering(TrainingInputs=text_split, OfClusters=amount_of_colors_for_big_panels, RandomSeed=3)  # -> Result, Likelihood, Centroids
mesh_closest_point_2 = MeshClosestPoint(Point=area_2.Centroid, Mesh=import_image)  # -> Point, Index, Parameter
mesh_eval_2 = MeshEval(Mesh=import_image, Parameter=mesh_closest_point_2.Parameter)  # -> Point, Normal, Colour
list_item_3 = ListItem(List=k_means_clustering.Centroids, Index=0, Wrap=True)  # -> Item, Item1, Item2
colour_2 = Colour(simplify(mesh_eval_2.Colour))
colour_rgb = ColourRGB(Alpha=255, Red=list_item_3.Item, Green=list_item_3.Item1, Blue=list_item_3.Item2)  # -> flatten(Colour)
text_split_2 = TextSplit(Text=colour_2, Separators=",")
list_item_4 = ListItem(List=colour_rgb, Index=k_means_clustering.Result, Wrap=True)
k_means_clustering_2 = KMeansClustering(TrainingInputs=text_split_2, OfClusters=amount_of_colors_for_colors, RandomSeed=3)  # -> Result, Likelihood, Centroids
list_item_5 = ListItem(List=k_means_clustering_2.Centroids, Index=0, Wrap=True)  # -> Item, Item1, Item2
create_set = CreateSet(List=k_means_clustering_2.Result)  # -> Set, Map
colour_rgb_2 = ColourRGB(Alpha=255, Red=list_item_5.Item, Green=list_item_5.Item1, Blue=list_item_5.Item2)  # -> flatten(Colour)
member_index = MemberIndex(Set=k_means_clustering_2.Result, Member=create_set.Set)  # -> Index, Count
sort_list = SortList(Keys=member_index.Count, ValuesValuesA=colour_rgb_2)  # -> Keys, ValuesValuesA
list_item_6 = ListItem(List=sort_list.ValuesValuesA, Index=-1, Wrap=True)
dispatch = Dispatch(List=isotrim, DispatchPattern=way_of_working)  # -> ListA, ListB
dispatch_2 = Dispatch(List=list_item_4, DispatchPattern=way_of_working)  # -> ListA, ListB
dispatch_3 = Dispatch(List=surface, DispatchPattern=way_of_working)  # -> ListA, ListB
dispatch_4 = Dispatch(List=list_item_6, DispatchPattern=way_of_working)  # -> ListA, ListB

# ----
# area to be divided
number_slider_2 = Slider(28, range=1..100)
number_slider_3 = Slider(25, range=1..100)
value_list = ValueList({"hexagonal": 0, "diamond": 1, "rectangle": 2, "triangle": 3, "bricks": 4}, selected="diamond")
surface_2 = Surface(read.Bounds)

# ----
# dividing to panels
stream_gate = StreamGate(Stream=surface_2, Gate=value_list)  # -> Target0, Target1, Target2, Target3, Target4
diamond_panels = DiamondPanels(Surface=stream_gate.Target1, UDivisions=number_slider_2, VDivisions=number_slider_3)  # -> DiamondPanels, TriPanels
quad_panels = QuadPanels(Surface=stream_gate.Target2, UDivisions=number_slider_2, VDivisions=number_slider_3)
triangular_panels_a = TriangularPanelsA(Surface=stream_gate.Target3, UDivisions=number_slider_2, VDivisions=number_slider_3)
hexagon_cells = HexagonCells(Surface=stream_gate.Target0, UDivisions=number_slider_2, VDivisions=number_slider_3, TParameter=0.25)  # -> HexagonCells, Centers
merge = Merge(
    Data1=hexagon_cells.HexagonCells,
    Data2=[diamond_panels.DiamondPanels, diamond_panels.TriPanels],
    Data3=quad_panels,
    Data4=triangular_panels_a)  # -> simplify(Result)

area_3 = Area(Geometry=dispatch.ListA)  # -> Area, Centroid

custom_preview = CustomPreview(Geometry=dispatch_3.ListA, Material=dispatch_4.ListA)
custom_preview_2 = CustomPreview(Geometry=dispatch.ListB, Material=dispatch_2.ListB)

output_panels = Geometry(merge)

# ----
# points to be divided to surfaces
point = Point(area_3.Centroid)

pull_point = PullPoint(Point=flatten(point), Geometry=simplify(graft(output_panels)), ClosestOnly=True)  # -> ClosestPoint, simplify(Distance), Index
smaller_than = SmallerThan(FirstNumber=pull_point.Distance, SecondNumber="0.0001")  # -> SmallerThan, OrEqualTo
dispatch_5 = Dispatch(List=simplify(pull_point.ClosestPoint), DispatchPattern=smaller_than.SmallerThan)  # -> ListA, ListB

cells = Surface(dispatch.ListB)
output_points_divided_to_surfaces = Geometry(dispatch_5.ListA)
colour_3 = Colour(dispatch_2.ListB)
number_slider_4 = Slider(0.01, range=0..0.01)

# ---- group: Frame Height
number_slider_5 = Slider(6, range=0..10)

# ----
deconstruct_brep = DeconstructBrep(Brep=cells)  # -> Faces, Edges, Vertices
unit_z = UnitZ(Factor=number_slider_5)
flip_curve = FlipCurve(Curve=deconstruct_brep.Edges)  # -> Curve, Flag

# ---- group: Frame Thickness
number_slider_6 = Slider(4, range=0..10)

# ----
negative = Negative(Value=number_slider_6)

# ---- group: Thickness of a cell
number_slider_7 = Slider(2, range=1..10)

# ----
extrude = Extrude(Base=flip_curve.Curve, Direction=unit_z)
flip_curve_2 = FlipCurve(Curve=cells)  # -> Curve, Flag
subtraction = Subtraction(A=negative, B="0.1")
offset_curve = OffsetCurve(Curve=flip_curve_2.Curve, Distance=subtraction, Corners=1)
negative_2 = Negative(Value=number_slider_6)
negative_3 = Negative(Value=number_slider_7)
unit_z_2 = UnitZ(Factor=negative_3)
surface_3 = Surface(offset_curve)
negative_4 = Negative(Value=unit_z_2)
move = Move(Geometry=surface_3, Motion=unit_z_2)  # -> Geometry, Transform
division_3 = Division(A=number_slider_5, B="2")
multiplication = Multiplication(A=negative_4, B="2")
unit_z_3 = UnitZ(Factor=division_3)
extrude_2 = Extrude(Base=move.Geometry, Direction=multiplication)

# ---- group: output
offset_surface = OffsetSurface(Surface=extrude, Distance=number_slider_6, BothSides=negative_2, CreateSolid=Toggle(True))  # -> flatten(Offset)
move_2 = Move(Geometry=extrude_2, Motion=unit_z_3)  # -> Geometry, Transform

# ----
yz_plane = YZPlane(Origin=Point(0, 0, 0))

# ---- group: TRANSPARENCY
number_slider_8 = Slider(0.3, range=0..1)

# ----
rotate = Rotate(Geometry=move_2.Geometry, Angle=1.570796327, Plane=yz_plane)  # -> flatten(Geometry), Transform
rotate_2 = Rotate(Geometry=offset_surface, Angle=1.570796327, Plane=yz_plane)  # -> flatten(Geometry), Transform
colour_swatch = ColourSwatch(SwatchColor=RGB(0, 0, 0))
create_material = CreateMaterial(Diffuse=colour_3, Specular=RGB(255, 255, 255), Emission=RGB(0, 0, 0), Transparency=number_slider_8, Shine=0)
create_material_2 = CreateMaterial(Diffuse=colour_swatch, Specular=colour_swatch, Emission=RGB(0, 0, 0), Transparency=0, Shine=0)

brep = Brep(rotate_2.Geometry)
brep_2 = Brep(flatten(rotate.Geometry))
model_material = ModelMaterial(create_material)
model_material_2 = ModelMaterial(create_material_2)
speckle_model = SpeckleModel(
    Model="df97a50075",
    Project="566e6518c0",
    Server="https://app.speckle.systems",
    User="FDB1F9747CCB927236FC87E590B7A656",
    Workspace="1389b8e908")

list_item_7 = ListItem(List=brep, Index=0, Wrap=True)
mesh = Mesh(brep)
mesh_2 = Mesh(brep_2)

speckle_geometry = SpeckleGeometry(Geometry=flatten(mesh), Material=model_material_2, HasApplicationIdParam=False)  # -> SpeckleGeometry, Geometry, Name, Properties, Color, Material, Path
custom_preview_3 = CustomPreview(Geometry=mesh, Material=model_material_2)
speckle_geometry_2 = SpeckleGeometry(Geometry=flatten(mesh_2), Material=model_material, HasApplicationIdParam=False)  # -> SpeckleGeometry, Geometry, Name, Properties, Color, Material, Path
speckle_data_object = SpeckleDataObject(Geometries=flatten(speckle_geometry.SpeckleGeometry), HasApplicationIdParam=False, IsDesignOption=False)  # -> SpeckleDataObject, Geometries, Name, Properties, Path
custom_preview_4 = CustomPreview(Geometry=flatten(speckle_geometry_2.Geometry), Material=speckle_geometry_2.Material)
speckle_data_object_2 = SpeckleDataObject(Geometries=flatten(speckle_geometry_2.SpeckleGeometry), HasApplicationIdParam=False, IsDesignOption=False)  # -> SpeckleDataObject, Geometries, Name, Properties, Path
create_collection = CreateCollection(
    SubCollection1=speckle_data_object.SpeckleDataObject,
    SubCollection2=speckle_data_object_2.SpeckleDataObject,
    AlwaysInheritNames=False)
publish = Publish(SpeckleModel=speckle_model, Collection=create_collection)  # -> SpeckleModel, VersionID
panel = Panel(publish.SpeckleModel)

deconstruct_brep_2 = DeconstructBrep(Brep=list_item_7)  # -> Faces, Edges, Vertices
