# Grasshopper definition 3 3dmodel_with_frames 2.gh (Grasshopper 1.0.8)
# plug-ins: Pufferfish

# ---- group: Input
surface = Surface([<surface referenced from the Rhino model> x8])
panel = Panel(surface)
panel_2 = Panel([ColourSwatch(SwatchColor=RGB(0, 0, 0)), ColourSwatch(SwatchColor=RGB(99, 20, 20)), ColourSwatch(SwatchColor=RGB(255, 0, 0)), ColourSwatch(SwatchColor=RGB(255, 255, 255)), ColourSwatch(SwatchColor=RGB(201, 189, 189)), ColourSwatch(SwatchColor=RGB(0, 150, 35)), ColourSwatch(SwatchColor=RGB(196, 0, 255)), ColourSwatch(SwatchColor=RGB(156, 172, 255))])

# ----
deconstruct_brep = DeconstructBrep(Brep=surface)  # -> Faces, Edges, Vertices
flip_curve = FlipCurve(Curve=surface)  # -> Curve, Flag
number_slider = Slider(0.4, range=0..1)
negative = Negative(Value=Slider(0.01, range=0..0.01))
flip_curve_2 = FlipCurve(Curve=deconstruct_brep.Edges)  # -> Curve, Flag
offset_curve = OffsetCurve(Curve=flip_curve.Curve, Distance=negative, Corners=1)
unit_z = UnitZ(Factor=number_slider)
number_slider_2 = Slider(0.03, range=0..0.1)
number_slider_3 = Slider(0.1, range=0..0.1)
extrude = Extrude(Base=flip_curve_2.Curve, Direction=unit_z)
negative_2 = Negative(Value=number_slider_3)
negative_3 = Negative(Value=number_slider_2)
construct_domain = ConstructDomain(DomainStart=number_slider_2, DomainEnd=negative_3)
unit_z_2 = UnitZ(Factor=construct_domain)
surface_2 = Surface(offset_curve)
division = Division(A=number_slider, B="2")
negative_4 = Negative(Value=unit_z_2)
extrude_2 = Extrude(Base=surface_2, Direction=unit_z_2)
extrude_3 = Extrude(Base=surface_2, Direction=negative_4)
unit_z_3 = UnitZ(Factor=division)
solid_union = SolidUnion(Breps=[extrude_2, extrude_3])

# ---- group: output
offset_surface = OffsetSurface(Surface=extrude, Distance=number_slider_3, BothSides=negative_2, CreateSolid=Toggle(True))
move = Move(Geometry=solid_union, Motion=unit_z_3)  # -> Geometry, Transform
merge = Merge(Data1=offset_surface, Data2=move.Geometry)

# ----
solid_difference = SolidDifference(BrepsA=offset_surface, BrepsB=flatten(move.Geometry))  # disabled
colour_swatch = ColourSwatch(SwatchColor=RGB(212, 104, 104))

# ---- group: display
create_material = CreateMaterial(Diffuse=panel_2, Specular=RGB(255, 255, 255), Emission=RGB(0, 0, 0), Transparency=Slider(0.8, range=0..1), Shine=0)
custom_preview = CustomPreview(Geometry=flatten(offset_surface), Material=colour_swatch)
custom_preview_2 = CustomPreview(Geometry=flatten(move.Geometry), Material=create_material)

# ----
custom_preview_3 = CustomPreview(Geometry=solid_difference, Material=colour_swatch)
